# Grasshopper definition mmconnect.ghx (Grasshopper 1.0.7)
# plug-ins: RhinoCodePluginGH, Human

pt = Point([Point(-141942, -296785.6585, 281477.9512), Point(36775, -343999, 117377.4878), Point(-116931, -403771, 0), Point(72762, -476353, 0), Point(-3981.574136, -486555, 262152.6307)])
pline = PolyLine(Vertices=pt, Closed=False)
mmcl = MmcoreExampleClient(x=pt, enable=Toggle(True))  # -> out, a; inputs x: list of Point3d, enable: Boolean
# ---------- mmcl: Python ----------
"""
Прежде всего:
1. Закройте грассхоппер
2. Запустите ipython/PythonConsole/jupyter/... в окружении с установленным mmcore.
3. Запустите там SharedStateServer с помощью строк ниже:

from mmcore.base.sharedstate import serve
serve.start()

4. Выполните компонент (первый раз он должен вернуть null), передав в x список точек .
5. Вернитесь во взрослый python.
6. Создайте обработчик. Например:

from mmcore.geom.parametric.nurbs import NurbsCurve

def nurbs_resolver(**kws):
    n=NurbsCurve(kws.get("x"))
    return n.evaluate(np.linspace(0,1,100)).tolist()

7. Подключите обработчик к серверу:

serve.add_resolver(ID)=nurbs_resolver
Или используйте декоратор, в этом случае ID будет идентично имени функции:

@serve.resolver
def nurbs_resolver(**kws):
    n=NurbsCurve(kws.get(x))
    return n.evaluate(np.linspace(0,1,100)).tolist()

* ID может быть любой строкой. Главное чтобы ID обработчика
и значение переменной ID в нужном вам компоненте совпадали.
Ниже я использую в качестве ID ghenv.Component.ComponentGuid (Guid текущего компонента ).
ID также отображается в сообщении под компонентом.
Для упрощения, этот компонент печатает в out код необходимой вам команды.
Просто замените <resolver> на определенную вами функцию.
"""

# ! python 3

#ID = str(ghenv.Component.ComponentGuid)
ID = "nurbs_state_resolver"
ghenv.Component.set_Message("id: " + ID)
ghenv.Component.set_Name("mmcore example client")
ghenv.Component.set_NickName("mmcl")
ghenv.Component.set_Description("This component allows direct access to the running mmcore instance. " \
                                "You can send, return and execute any data in real time by communicating via IPython, PycharmConsole, Jupyter etc. ")
print(f'Команда добавления обработчика в ipython, PythonConsole, jupyter :\n\nserve.add_resolver({ID}, <resolver>)')

import Rhino.Geometry as rg
import ghpythonlib.treehelpers as th
import requests
import json


def pt(pts):
    return pts.X, pts.Y, pts.Z


def pts(rpts):
    for rpt in rpts:
        yield pt(rpt)


ns = dict()
if enable:
    resp = requests.post(f"http://localhost:7711/resolver/{ID}",
                     json={
                        "x": list(pts(x))
                        }
                     )
    ans = resp.json()

    if ans:
        a = th.list_to_tree(resp.json())
# ---------- end mmcl ----------
num2pt = NumbersToPoints(Numbers=mmcl.a, Mask=4)  # -> flatten(Points)
pline_2 = PolyLine(Vertices=num2pt, Closed=False)

pt_2 = Point([Point(-141942, -323725, 281477.9512), Point(36775, -343999, 117377.4878), Point(-276551.3212, -403771, -103242.1989), Point(57783.66293, -476353, 0), Point(-22574.24595, -486555, 262152.6307)])
pline_3 = PolyLine(Vertices=pt_2, Closed=False)
mmcl_2 = MmcoreExampleClient(x=pt_2, enable=Toggle(True))  # -> out, a; inputs x: list of Point3d, enable: Boolean
# ---------- mmcl_2: Python ----------
"""
Прежде всего:
1. Закройте грассхоппер
2. Запустите ipython/PythonConsole/jupyter/... в окружении с установленным mmcore.
3. Запустите там SharedStateServer с помощью строк ниже:

from mmcore.base.sharedstate import serve
serve.start()

4. Выполните компонент (первый раз он должен вернуть null), передав в x список точек .
5. Вернитесь во взрослый python.
6. Создайте обработчик. Например:

from mmcore.geom.parametric.nurbs import NurbsCurve

def nurbs_resolver(**kws):
    n=NurbsCurve(kws.get("x"))
    return n.evaluate(np.linspace(0,1,100)).tolist()

7. Подключите обработчик к серверу:

serve.add_resolver(ID)=nurbs_resolver
Или используйте декоратор, в этом случае ID будет идентично имени функции:

@serve.resolver
def nurbs_resolver(**kws):
    n=NurbsCurve(kws.get(x))
    return n.evaluate(np.linspace(0,1,100)).tolist()

* ID может быть любой строкой. Главное чтобы ID обработчика
и значение переменной ID в нужном вам компоненте совпадали.
Ниже я использую в качестве ID ghenv.Component.ComponentGuid (Guid текущего компонента ).
ID также отображается в сообщении под компонентом.
Для упрощения, этот компонент печатает в out код необходимой вам команды.
Просто замените <resolver> на определенную вами функцию.
"""

# ! python 3

#ID = str(ghenv.Component.ComponentGuid)
ID = "nurbs_resolver"
ghenv.Component.set_Message("id: " + ID)
ghenv.Component.set_Name("mmcore example client")
ghenv.Component.set_NickName("mmcl")
ghenv.Component.set_Description("This component allows direct access to the running mmcore instance. " \
                                "You can send, return and execute any data in real time by communicating via IPython, PycharmConsole, Jupyter etc. ")
print(f'Команда добавления обработчика в ipython, PythonConsole, jupyter :\n\nserve.add_resolver({ID}, <resolver>)')

import Rhino.Geometry as rg
import ghpythonlib.treehelpers as th
import requests
import json


def pt(pts):
    return pts.X, pts.Y, pts.Z


def pts(rpts):
    for rpt in rpts:
        yield pt(rpt)


ns = dict()
if enable:
    resp = requests.post(f"http://localhost:7711/resolver/{ID}",
                     json={
                        "x": list(pts(x))
                        }
                     )
    ans = resp.json()

    if ans:
        a = th.list_to_tree(resp.json())
# ---------- end mmcl_2 ----------
num2pt_2 = NumbersToPoints(Numbers=mmcl_2.a, Mask=4)  # -> flatten(Points)
pline_4 = PolyLine(Vertices=num2pt_2, Closed=False)

previewlw = CustomPreviewLineweights(Geometry=[pline_4, pline_2], Shader=ColourSwatch(SwatchColor=RGB(192, 150, 18)), Thickness=3, Absolute=False)
previewlw_2 = CustomPreviewLineweights(Geometry=[pline_3, pline], Shader=ColourSwatch(SwatchColor=RGB(122, 122, 122)), Absolute=False)
dots = DotDisplay(Point=[pt, pt_2], Colour=ColourSwatch(SwatchColor=RGB(191, 191, 191)), Size=3070)
